# Grasshopper definition assignment-01.gh (Grasshopper 1.0.8)

# ---- group: Auto-reloads cdf module on VScode changes
path = FilePath("C:\Daten lokal\TUM Laptop\3. Semester\Computational Design and Fabrication\Github\cdf1_teaching\src\")
autoreloader = Python3Script(src_path=path)  # -> out; inputs src_path: String
# ---------- autoreloader: Python ----------
#! python3
import sys, os, time
import scriptcontext as sc
import Rhino, System
from System.IO import FileSystemWatcher

VERSION = 2  
pkg = "cdf"

if not src_path:
    raise Exception("Connect a folder to src_path.")
path = os.path.normpath(src_path)
watch_dir = os.path.join(path, pkg)
if not os.path.isdir(watch_dir):
    raise Exception("No '{}' folder found in:\n{}".format(pkg, path))

def unload():
    for name in list(sys.modules):
        if name == pkg or name.startswith(pkg + "."):
            del sys.modules[name]

# Put this folder first in Python's search list
if path in sys.path:
    sys.path.remove(path)
sys.path.insert(0, path)

key = "cdf_watcher_" + str(ghenv.Component.InstanceGuid)
time_key = key + "_time"
version_key = key + "_version"

def stamp():
    sc.sticky[time_key] = time.strftime("%Y-%m-%d %H:%M:%S")

# Replace the old watcher if the folder changed or the script was updated
old = sc.sticky.get(key)
if old is not None and (os.path.normpath(old.Path) != watch_dir
                        or sc.sticky.get(version_key) != VERSION):
    old.Dispose()
    del sc.sticky[key]
    unload()

if key not in sc.sticky:
    comp = ghenv.Component
    last = [0.0]

    def reload_and_rerun():
        unload()
        stamp()
        doc = comp.OnPingDocument()
        if doc is None:            # reloader was deleted or the file closed
            return
        for obj in doc.Objects:
            if "Python" in obj.GetType().Name:
                obj.ExpireSolution(False)   # mark as out of date
        doc.NewSolution(False)              # recompute once

    def on_change(sender, e):
        if not e.FullPath.endswith(".py") or "__pycache__" in e.FullPath:
            return
        if time.time() - last[0] < 0.5:     # ignore the second event of a double save
            return
        last[0] = time.time()
        Rhino.RhinoApp.InvokeOnUiThread(System.Action(reload_and_rerun))

    w = FileSystemWatcher(watch_dir, "*.py")
    w.IncludeSubdirectories = True
    # default filter reports writes AND renames, so editors that save via a
    # temporary file (write + rename) are caught as well
    w.Changed += on_change
    w.Created += on_change
    w.Renamed += on_change
    w.EnableRaisingEvents = True
    sc.sticky[key] = w
    sc.sticky[version_key] = VERSION
    stamp()                                  # time the watcher started

msg = "Last reloaded: {}\nWatching: {}".format(sc.sticky.get(time_key, "unknown"), watch_dir)
print(msg)
out = msg
# ---------- end autoreloader ----------
panel = Panel(autoreloader)

# ---- group: Variante 1
pt = ConstructPoint(XCoordinate=Slider(0, range=0..200), YCoordinate=Slider(0, range=0..1), ZCoordinate=Slider(0, range=0..1))
py3 = Python3Script(
    R=Slider(10.193, range=5..20),
    nc=Slider(11, range=0..50),
    tilt=Slider(34.765, range=0..60),
    w=Slider(9, range=1..12),
    no=Slider(29, range=1..60),
    seed=Slider(65, range=0..100),
    pt=pt,
    sp="U",
    gap=Slider(0, range=0..0.5))  # -> rims, ring, curve, objects, colors, planet; inputs pt: Point3d, sp: String, gap: Double
# ---------- py3: Python ----------
  
from cdf.assignment_01_bauhaus import create_bauhaus_planet
planet, rims, ring, curve, objects, colors = create_bauhaus_planet(
    planet_radius=R, crater_count=nc, ring_tilt=tilt,
    curve_waves=w, object_count=no, seed=seed,
    center=pt, side_pattern=sp, object_gap=gap)
# ---------- end py3 ----------
preview = CustomPreview(Geometry=py3.planet, Material=ColourSwatch(SwatchColor=RGB(224, 175, 76)))
preview_2 = CustomPreview(Geometry=py3.ring, Material=ColourSwatch(SwatchColor=RGB(240, 240, 151)))
preview_3 = CustomPreview(Geometry=py3.objects, Material=py3.colors)

# ---- group: Variante 1 / Variante 2
pt_2 = ConstructPoint(XCoordinate=Slider(150, range=0..200), YCoordinate=Slider(0, range=0..1), ZCoordinate=Slider(0, range=0..1))
py3_2 = Python3Script(
    R=Slider(19.377, range=5..20),
    nc=Slider(49, range=0..50),
    tilt=Slider(13.637, range=0..60),
    w=Slider(1, range=1..12),
    no=Slider(39, range=1..60),
    seed=Slider(89, range=0..100),
    pt=pt_2,
    sp="UD",
    gap=Slider(0.43, range=0..0.5))  # -> rims, ring, curve, objects, colors, planet; inputs pt: Point3d, sp: String, gap: Double; same code as py3
preview_4 = CustomPreview(Geometry=py3_2.planet, Material=ColourSwatch(SwatchColor=RGB(161, 26, 26)))
preview_5 = CustomPreview(Geometry=py3_2.ring, Material=ColourSwatch(SwatchColor=RGB(148, 75, 133)))
preview_6 = CustomPreview(Geometry=py3_2.objects, Material=py3_2.colors)

# ---- group: Variante 3: Universum
pt_3 = ConstructPoint(XCoordinate=Slider(385.521, range=0..400), YCoordinate=Slider(0, range=0..200), ZCoordinate=Slider(0, range=0..200))
py3_3 = Python3Script(
    n=Slider(9, range=1..15),
    rmin=Slider(2, range=2..10),
    rmax=Slider(18, range=5..20),
    spread=Slider(1, range=1..3),
    tilt=Slider(71, range=0..90),
    nc=Slider(11, range=0..20),
    no=Slider(16, range=1..40),
    seed=Slider(43, range=0..100),
    pt=pt_3)  # -> out, planets, rings, curves, objects, obj_colors, planet_colors, ring_colors; inputs n: Int32, rmin: Double, rmax: Double, spread: Double, tilt: Double, nc: Int32, no: Int32, seed: Int32, pt: Point3d
# ---------- py3_3: Python ----------
from cdf.assignment_01_bauhaus import create_bauhaus_universe
planets, rings, curves, objects, obj_colors, planet_colors, ring_colors = create_bauhaus_universe(
    center=pt, planet_count=n, radius_min=rmin, radius_max=rmax,
    spread=spread, max_tilt=tilt, crater_count=nc, object_count=no, seed=seed)
# ---------- end py3_3 ----------
preview_7 = CustomPreview(Geometry=py3_3.planets, Material=py3_3.planet_colors)
preview_8 = CustomPreview(Geometry=py3_3.rings, Material=py3_3.ring_colors)
preview_9 = CustomPreview(Geometry=py3_3.objects, Material=py3_3.obj_colors)
