# Grasshopper definition assignment-02-1.gh (Grasshopper 1.0.8)

hyperbolic_trumpet = Python3Script(
    radius=Slider(3.99, range=2..20),
    height=Slider(12.28, range=2..20),
    flare=Slider(2.521, range=2..20),
    growth=Slider(3, range=1..20),
    waves=Slider(8, range=0..20),
    curve_count=Slider(11, range=0..20),
    resolution=Slider(144, range=-1..300))  # -> mesh, curves
# ---------- hyperbolic_trumpet: Python ----------
import importlib
import cdf.algorithms
importlib.reload(cdf.algorithms)
from cdf.algorithms import create_hyperbolic_trumpet

mesh, curves = create_hyperbolic_trumpet(
    radius=radius, height=height, flare=flare, growth=growth,
    waves=waves, curve_count=curve_count, resolution=resolution)
# ---------- end hyperbolic_trumpet ----------
panel = Panel(hyperbolic_trumpet.mesh)
panel_2 = Panel(hyperbolic_trumpet.curves)

# ----
# Assignment-02.1: Hyperbolic Surface
number_slider = Slider(23.502, range=10..50)
list = ValueList({"linear", "peak", "wave"}, selected="peak")
hyperbolic_strip = Python3Script(
    length=number_slider,
    width=Slider(16.644, range=1..25),
    growth=Slider(4.126, range=1..25),
    profile=list,
    waves=Slider(8, range=1..25),
    curve_count=Slider(9, range=1..25),
    resolution=Slider(120, range=1..250))  # -> mesh, curves; inputs profile: String
# ---------- hyperbolic_strip: Python ----------
import importlib
import cdf.algorithms
importlib.reload(cdf.algorithms)
from cdf.algorithms import create_hyperbolic_strip

mesh, curves = create_hyperbolic_strip(
    length=length, width=width, growth=growth, profile=profile,
    waves=waves, curve_count=curve_count, resolution=resolution)
# ---------- end hyperbolic_strip ----------

list_2 = ValueList({"Band": 0, "Trompete": 1}, selected="Trompete")
filter = StreamFilter(Gate=list_2, Stream0=hyperbolic_strip.mesh, Stream1=hyperbolic_trumpet.mesh)
preview = CustomPreview(Geometry=filter, Material=ColourSwatch(SwatchColor=RGB(107, 52, 173)))
